# Dynamo graph test.dyn (Dynamo 1.3.0.875)

file_path = Filename("C:\Users\Mostapha\Documents\code\ladybug-tools\dynosaur\test.py")
fromPath = FileObject(file_path)  # "File.FromPath"
readText = File.ReadText(fromPath)
code_block = CodeBlock { true; }
python_script = Python(IN[0]=code_block)
# ---------- python_script.python (32 lines) ----------
import clr
clr.AddReference("RevitAPI")
from Autodesk.Revit.DB import FilteredElementCollector, BuiltInCategory

clr.AddReference("RevitServices")
from RevitServices.Persistence import DocumentManager

def collectRooms(document=None):
    """Collect all the rooms in the current Revit document."""
    if not document:
        document = DocumentManager.Instance.CurrentDBDocument
    collector = FilteredElementCollector(document)
    collector.OfCategory(BuiltInCategory.OST_Rooms)
    roomIter = collector.GetElementIdIterator()
    roomIter.Reset()
    return tuple(document.GetElement(elId) for elId in roomIter)


def collectMEPSpaces(document=None):
    """Collect all the spaces in the current Revit document."""
    if not document:
        document = DocumentManager.Instance.CurrentDBDocument
    collector = FilteredElementCollector(document)
    collector.OfCategory(BuiltInCategory.OST_MEPSpaces)
    roomIter = collector.GetElementIdIterator()
    roomIter.Reset()
    return tuple(document.GetElement(elId) for elId in roomIter)
    

if IN[0]:
	doc = DocumentManager.Instance.CurrentDBDocument
	OUT = collectRooms(doc), collectMEPSpaces(doc)
# ----------------------------------------
code_block_2 = CodeBlock(out=python_script) { rooms = out[0]; spaces = out[1]; }
watch = Watch(code_block_2.rooms)
python_script_from_string = PythonStringNode(script=readText, IN[0]=watch)
code_block_3 = CodeBlock(x=python_script_from_string) { x[0]; x[1][0]; x[1][1]; x[2]; }
code_block_4 = CodeBlock(points=code_block_3.out2) { fenestration = Surface.ByPerimeterPoints(points); Color.ByARGB(100, 0, 100, 200); }
byGeometryColor = Display.Display.ByGeometryColor(code_block_4.fenestration, code_block_4.out1)
walls_as_polygons = Polygon.ByPoints(code_block_3.out1)
log = Watch(code_block_3.out0)
code_block_5 = CodeBlock(x=watch) { {x[7]}; }
watch_2 = Watch(code_block_3.out2)
code_block_6 = CodeBlock(watch) { Room.Name; }
watch_3 = Watch(code_block_6)
watch_4 = Watch(python_script_from_string)
